# Grasshopper definition kinematics_Costello2020.gh (Grasshopper 1.0.7)

# ---- group: Snapshot 1
theta3 = Slider(2.2, range=0..2.5)
t0 = Slider(0.101, range=0..0.25)
theta1 = Slider(0.462, range=0..1.57)
theta2 = Slider(1.102, range=0..1.57)
t1 = Slider(0.081, range=0..0.25)
theta0 = Slider(0.44, range=0..1.57)
t2 = Slider(0.063, range=0..0.25)
l0 = Slider(0.08, range=0..0.25)
l1 = Slider(0.118, range=0..0.25)
t3 = Slider(0.033, range=0..0.25)
l2 = Slider(0.194, range=0..0.25)
t4 = Slider(0.011, range=0..0.25)
l3 = Slider(0.228, range=0..0.25)
l4 = Slider(0.25, range=0..0.25)

# ---- group: Snapshot 2
theta2_2 = Slider(1.57, range=0..1.57)
t2_2 = Slider(0.069, range=0..0.25)
theta3_2 = Slider(0.125, range=0..2.5)
t0_2 = Slider(0.099, range=0..0.25)
theta1_2 = Slider(0.831, range=0..1.57)
t1_2 = Slider(0.102, range=0..0.25)
l0_2 = Slider(0.052, range=0..0.25)
theta0_2 = Slider(0.147, range=0..1.57)
l1_2 = Slider(0.105, range=0..0.25)
t3_2 = Slider(0.031, range=0..0.25)
t4_2 = Slider(0.011, range=0..0.25)
l2_2 = Slider(0.25, range=0..0.25)
l3_2 = Slider(0.179, range=0..0.25)
l4_2 = Slider(0.165, range=0..0.25)

# ---- group: Snapshot 3
t2_3 = Slider(0.048, range=0..0.25)
theta3_3 = Slider(2.2, range=0..2.5)
t0_3 = Slider(0.09, range=0..0.25)
theta1_3 = Slider(1.279, range=0..1.57)
theta2_3 = Slider(1.437, range=0..1.57)
t1_3 = Slider(0.077, range=0..0.25)
l0_3 = Slider(0.103, range=0..0.25)
theta0_3 = Slider(0.427, range=0..1.57)
l1_3 = Slider(0.163, range=0..0.25)
t3_3 = Slider(0.024, range=0..0.25)
t4_3 = Slider(0.011, range=0..0.25)
l2_3 = Slider(0.194, range=0..0.25)
l3_3 = Slider(0.228, range=0..0.25)
l4_3 = Slider(0.25, range=0..0.25)

# ----
theta2_4 = Slider(1.57, range=0..1.57)
t2_4 = Slider(0.069, range=0..0.25)
theta3_4 = Slider(0.125, range=0..2.5)
t0_4 = Slider(0.099, range=0..0.25)
theta1_4 = Slider(0.831, range=0..1.57)
t1_4 = Slider(0.102, range=0..0.25)
l0_4 = Slider(0.052, range=0..0.25)
theta0_4 = Slider(0.147, range=0..1.57)
l1_4 = Slider(0.105, range=0..0.25)
t3_4 = Slider(0.031, range=0..0.25)
t4_4 = Slider(0.011, range=0..0.25)
l2_4 = Slider(0.25, range=0..0.25)
l3_4 = Slider(0.179, range=0..0.25)
l4_4 = Slider(0.165, range=0..0.25)
vector_xyz = VectorXYZ(XComponent=l1_4, YComponent=0, ZComponent=0)  # -> Vector, Length
vector_xyz_2 = VectorXYZ(XComponent=l2_4, YComponent=0, ZComponent=0)  # -> Vector, Length
vector_xyz_3 = VectorXYZ(XComponent=l0_4, YComponent=0, ZComponent=0)  # -> Vector, Length
vector_xyz_4 = VectorXYZ(XComponent=l3_4, YComponent=0, ZComponent=0)  # -> Vector, Length
vector_xyz_5 = VectorXYZ(XComponent=l4_4, YComponent=0, ZComponent=0)  # -> Vector, Length
point = Point(Point(0, 0, 0))
rotate = Rotate(Vector=vector_xyz.Vector, Axis=Vector(0, 0, -1), Angle=theta0_4)
move = Move(Geometry=point, Motion=vector_xyz_3.Vector)  # -> Geometry, Transform
rotate_2 = Rotate(Vector=vector_xyz_2.Vector, Axis=Vector(0, 0, -1), Angle=theta1_4)
rotate_3 = Rotate(Vector=vector_xyz_4.Vector, Axis=Vector(0, 0, -1), Angle=theta2_4)
rotate_4 = Rotate(Vector=vector_xyz_5.Vector, Axis=Vector(0, 0, -1), Angle=theta3_4)
move_2 = Move(Geometry=move.Geometry, Motion=rotate)  # -> Geometry, Transform
move_3 = Move(Geometry=move_2.Geometry, Motion=rotate_2)  # -> Geometry, Transform
move_4 = Move(Geometry=move_3.Geometry, Motion=rotate_3)  # -> Geometry, Transform
move_5 = Move(Geometry=move_4.Geometry, Motion=rotate_4)  # -> Geometry, Transform
point_2 = Point(move.Geometry)
mirror = Mirror(Geometry=point_2, Plane=PlaneYZ(0, 0, 0))  # -> Geometry, Transform
point_3 = Point(mirror.Geometry)
point_4 = Point(move_2.Geometry)
point_5 = Point(move_4.Geometry)
point_6 = Point(move_3.Geometry)
point_7 = Point(move_5.Geometry)
cluster = Cluster_2(startpoint=point_5, endpoint=point_7, thickness=t4_4)  # -> point1_2, point2_2
cluster_2 = Cluster_2(startpoint=point_6, endpoint=point_5, thickness=t3_4)  # -> point1_2, point2_2
cluster_3 = Cluster_2(startpoint=point_4, endpoint=point_6, thickness=t2_4)  # -> point1_2, point2_2
cluster_4 = Cluster(startpoint=point_2, endpoint=point_4, thickness=t1_4)  # -> point1_2, point2_2
cluster_5 = Cluster_2(startpoint=point_3, endpoint=point_2, thickness=t0_4)  # -> point1_2, point2_2
nurbs_curve = NurbsCurve(
    Vertices=[cluster_5.point1_2, cluster_4.point1_2, cluster_3.point1_2, cluster_2.point1_2, cluster.point1_2, cluster.point2_2, cluster_2.point2_2, cluster_3.point2_2, cluster_4.point2_2, cluster_5.point2_2],
    Degree=3,
    Periodic=False)  # -> Curve, Length, Domain

# ==== cluster Cluster
startpoint = ClusterInput()
endpoint = ClusterInput()
thickness = ClusterInput()
startpoint_2 = Point(startpoint)
endpoint_2 = Point(endpoint)
thickness_2 = Number(thickness)
line = Line(StartPoint=startpoint_2, EndPoint=endpoint_2)
curve_middle = CurveMiddle(Curve=line)
move = Move(Geometry=curve_middle, Motion=Vector(0, 0, 1))  # -> Geometry, Transform
line_2 = Line(StartPoint=curve_middle, EndPoint=endpoint_2)
line_3 = Line(StartPoint=curve_middle, EndPoint=move.Geometry)
vector_2pt = Vector2Pt(PointA=curve_middle, PointB=endpoint_2, Unitize=True)  # -> Vector, Length
rotate_axis = RotateAxis(Geometry=line_2, Angle=1.570796327, Axis=line_3)  # -> Geometry, Transform
multiplication = Multiplication(A=thickness_2, B=-1)
evaluate_length = EvaluateLength(Curve=rotate_axis.Geometry, Length=1, Normalized=True)  # -> Point, Tangent, Parameter
multiplication_2 = Multiplication(A=evaluate_length.Tangent, B=thickness_2)
multiplication_3 = Multiplication(A=evaluate_length.Tangent, B=multiplication)
move_2 = Move(Geometry=curve_middle, Motion=multiplication_3)  # -> Geometry, Transform
move_3 = Move(Geometry=curve_middle, Motion=multiplication_2)  # -> Geometry, Transform
point2 = Point(move_2.Geometry)
point2_2 = ClusterOutput(point2)
point1 = Point(move_3.Geometry)
point1_2 = ClusterOutput(point1)

# ==== cluster Cluster_2
startpoint = ClusterInput()
endpoint = ClusterInput()
thickness = ClusterInput()
startpoint_2 = Point(startpoint)
endpoint_2 = Point(endpoint)
thickness_2 = Number(thickness)
line = Line(StartPoint=startpoint_2, EndPoint=endpoint_2)
curve_middle = CurveMiddle(Curve=line)
move = Move(Geometry=curve_middle, Motion=Vector(0, 0, 1))  # -> Geometry, Transform
line_2 = Line(StartPoint=curve_middle, EndPoint=endpoint_2)
line_3 = Line(StartPoint=curve_middle, EndPoint=move.Geometry)
vector_2pt = Vector2Pt(PointA=curve_middle, PointB=endpoint_2, Unitize=True)  # -> Vector, Length
rotate_axis = RotateAxis(Geometry=line_2, Angle=1.570796327, Axis=line_3)  # -> Geometry, Transform
multiplication = Multiplication(A=thickness_2, B=-1)
evaluate_length = EvaluateLength(Curve=rotate_axis.Geometry, Length=1, Normalized=True)  # -> Point, Tangent, Parameter
multiplication_2 = Multiplication(A=evaluate_length.Tangent, B=thickness_2)
multiplication_3 = Multiplication(A=evaluate_length.Tangent, B=multiplication)
move_2 = Move(Geometry=curve_middle, Motion=multiplication_3)  # -> Geometry, Transform
move_3 = Move(Geometry=curve_middle, Motion=multiplication_2)  # -> Geometry, Transform
point2 = Point(move_2.Geometry)
point1 = Point(move_3.Geometry)
point2_2 = ClusterOutput(point2)
point1_2 = ClusterOutput(point1)
